# Dynamo graph Wall Panel Setup.dyn (Dynamo 2.1.0.7500)

# group: Select panel edges
bottom_edge = DSEdgeSelection()  # 1 picked in the model
left_edge = DSEdgeSelection()  # 1 picked in the model

# group: Panel Size
height_and_length = IntegerSlider(700, range=350..1000 step 50)

# group: Tessellate Panels
pointAtSegmentLength = Curve.PointAtSegmentLength(curve=bottom_edge)
X = Point.X(point=pointAtSegmentLength)
length = Curve.Length(curve=bottom_edge)
div = length / height_and_length
ceiling = Math.Ceiling(number=div)
div_2 = length / ceiling
code_block = CodeBlock { 2; }
div_3 = div_2 / code_block
add = X + div_3
sequence = Sequence(start=add, amount=ceiling, step=div_2)
Y = Point.Y(point=pointAtSegmentLength)
Z = Point.Z(point=pointAtSegmentLength)
length_2 = Curve.Length(curve=left_edge)
div_4 = length_2 / height_and_length
ceiling_2 = Math.Ceiling(number=div_4)
div_5 = length_2 / ceiling_2
sequence_2 = Sequence(start=Z, amount=ceiling_2, step=div_5)
byCoordinates = Point.ByCoordinates(x=sequence, y=Y, z=sequence_2, lacing=CrossProduct)

# group: Add wall panels
family_types = FamilyTypes("Wall Panel:Wall Panel")
byPoint = FamilyInstance.ByPoint(familyType=family_types, point=byCoordinates)
code_block_2 = CodeBlock { "b"; }
setParameterByName = Element.SetParameterByName(element=byPoint, parameterName=code_block_2, value=div_2)
code_block_3 = CodeBlock { "d"; }
setParameterByName_2 = Element.SetParameterByName(element=byPoint, parameterName=code_block_3, value=div_5)

# group: Panel depth method
integer_slider = IntegerSlider(1, range=1..2 step 1)
python_script = Python(IN[0]=byPoint, IN[1]=integer_slider)
# ---------- python_script.python (14 lines) ----------
# Load the Python Standard and DesignScript Libraries
import sys
import clr
clr.AddReference('ProtoGeometry')
from Autodesk.DesignScript.Geometry import *

# The inputs to this node will be stored as a list in the IN variables.
dataEnteringNode = IN

# Place your code below this line
if IN[1] == 1:
	OUT = [IN[0], []]
elif IN[1] == 2:
	OUT = [[], IN[0]] 
# ----------------------------------------

# group: Panel Depth Settings
integer_slider_2 = IntegerSlider(70, range=20..100 step 5)
integer_slider_3 = IntegerSlider(300, range=150..1000 step 150)

# group: Random Panel Depth
code_block_4 = CodeBlock(x=python_script) { x[0]; }
flatten = List.Flatten(list=code_block_4)
code_block_5 = CodeBlock { "T2"; }
code_block_6 = CodeBlock { 3; }
div_6 = integer_slider_2 / code_block_6
count = List.Count(list=flatten)
randomList = Math.RandomList(amount=count)
code_block_7 = CodeBlock { 10; }
mul = randomList * code_block_7
ceiling_3 = Math.Ceiling(number=mul)
div_7 = ceiling_3 / code_block_7
mul_2 = div_7 * integer_slider_3
code_block_8 = CodeBlock { 3; }
div_8 = mul_2 / code_block_8
add_2 = div_6 + div_8
setParameterByName_3 = Element.SetParameterByName(element=flatten, parameterName=code_block_5, value=add_2)
code_block_9 = CodeBlock { "T3"; }
code_block_10 = CodeBlock { 3/2; }
div_9 = integer_slider_2 / code_block_10
code_block_11 = CodeBlock { 3/2; }
div_10 = mul_2 / code_block_11
add_3 = div_9 + div_10
setParameterByName_4 = Element.SetParameterByName(element=flatten, parameterName=code_block_9, value=add_3)
code_block_12 = CodeBlock { "T4"; }
add_4 = integer_slider_2 + mul_2
setParameterByName_5 = Element.SetParameterByName(element=flatten, parameterName=code_block_12, value=add_4)

# group: Colour Panels
color_palette = ColorPalette({R: 255, G: 215, B: 0, A: 255})
color_palette_2 = ColorPalette({R: 105, G: 105, B: 105, A: 255})
code_block_13 = CodeBlock(x=color_palette, y=color_palette_2) { [x,y]; }
code_block_14 = CodeBlock { [0,1]; }
color_range = ColorRange(colors=code_block_13, indices=code_block_14, value=div_7)
overrideColorInView = Element.OverrideColorInView(element=flatten, color=color_range)

# group: Top down panel depths
code_block_15 = CodeBlock(x=python_script) { x[1]; }
code_block_16 = CodeBlock { "T4"; }
code_block_17 = CodeBlock { "OUT = [[15*j for j in range(len(i))] for i in IN[0]]"; }
python_script_from_string = PythonStringNode(script=code_block_17, IN[0]=byPoint)
code_block_18 = CodeBlock(x=python_script_from_string) { x*3; }
setParameterByName_6 = Element.SetParameterByName(element=code_block_15, parameterName=code_block_16, value=code_block_18)
code_block_19 = CodeBlock { "T3"; }
code_block_20 = CodeBlock(x=python_script_from_string) { x*2; }
setParameterByName_7 = Element.SetParameterByName(element=code_block_15, parameterName=code_block_19, value=code_block_20)
code_block_21 = CodeBlock { "T2"; }
setParameterByName_8 = Element.SetParameterByName(element=code_block_15, parameterName=code_block_21, value=python_script_from_string)
code_block_22 = CodeBlock { "OUT = [[1-j for j in i] for i in IN[0]]"; }
flatten_2 = List.Flatten(list=python_script_from_string)
maximumItem = List.MaximumItem(list=flatten_2)
div_11 = python_script_from_string / maximumItem
python_script_from_string_2 = PythonStringNode(script=code_block_22, IN[0]=div_11)

# group: Colour Panels
color_palette_3 = ColorPalette({R: 255, G: 215, B: 0, A: 255})
color_palette_4 = ColorPalette({R: 105, G: 105, B: 105, A: 255})
code_block_23 = CodeBlock(x=color_palette_3, y=color_palette_4) { [x,y]; }
code_block_24 = CodeBlock { [0,1]; }
color_range_2 = ColorRange(colors=code_block_23, indices=code_block_24, value=python_script_from_string_2)
overrideColorInView_2 = Element.OverrideColorInView(element=code_block_15, color=color_range_2)
